# Grasshopper definition Aether_Examples.gh (Grasshopper 0.9.76)
# plug-ins: Weaverbird

resolution = Slider(16, range=6..50)
boxsize = Slider(12.556, range=0..100)
box = DomainBox(Base=PlaneXY(0, 0, 0), X=boxsize, Y=boxsize, Z=boxsize)
edges = BrepEdges(Brep=box)  # -> Naked, Interior, NonManifold
division = Division(A=boxsize, B=resolution)

crv = Curve([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])
level = Slider(1.2, range=-1.2..1.2)
pt = Point([Point(3.831708752, 3.397676413, 3.444479589), Point(8.424474838, 4.661935047, 5.473544808), Point(4.91233607, 8.490514426, 8.979695309), Point(8.87664247, 8.289799775, 5.767690581)])
point_potential = CSharpScript(Q=Slider(0.017, range=-0.3..0.3), Pt=pt, Reference="C:\USERS\DANIEL\DOCUMENTS\GITHUB\AETHER\BIN\Aether.dll")  # -> out, A; inputs Q: Double, Pt: list of Point3d
# ---------- point_potential: C# ----------
    A = new SF(Q, Pt);
# ---------- point_potential: C# additional code ----------
  public class SF : ScalarField
  {
    public SF(){}
    double Q;
    List<Point3d> Pts;
    public SF(double _Q, List<Point3d> P)
    {
      Q = _Q;
      Pts = P;
    }
    public double ValueAt(Point3d P)
    {
      double Sum = 0;
      foreach(Point3d Pt in Pts)
      {
        Sum += (1.0 / (P - Pt).SquareLength) - Q;
      }
      return Sum;
    }
    public Vector3d GradientAt(Point3d P)
    {
      var VSum = new Vector3d();
      foreach(Point3d Pt in Pts)
      {
        Vector3d V = P - Pt;
        double Value = Math.Pow((V.SquareLength), 2);
        VSum -= 2 * V / Value;
      }
      return VSum;
    }
  }
# ---------- end point_potential ----------
curve_potential = CSharpScript(Q=Slider(0.584, range=0.3..0.6), C=crv, Reference="C:\USERS\DANIEL\DOCUMENTS\GITHUB\AETHER\BIN\Aether.dll")  # -> out, A; inputs Q: Double, C: list of Curve
# ---------- curve_potential: C# ----------
    A = new SF(Q, C);
# ---------- curve_potential: C# additional code ----------
  public class SF : ScalarField
  {
    public SF(){}
    double Q;
    List<Curve> Crv;
    public SF(double _Q, List<Curve> C)
    {
      Q = _Q;
      Crv = C;
    }
    public double ValueAt(Point3d P)
    {
      double Sum = 0;
      double t;
      foreach(Curve C in Crv)
      {
        C.ClosestPoint(P, out t);
        Point3d Pt = C.PointAt(t);
        Sum += (1.0 / (P - Pt).Length) - Q;
      }
      return Sum;
    }
    public Vector3d GradientAt(Point3d P)
    {
      double x = P.X;
      double y = P.Y;
      double z = P.Z;
      double t;
      var VSum = new Vector3d();
      
      foreach(Curve C in Crv)
      {
        C.ClosestPoint(P, out t);
        Point3d Pt = C.PointAt(t);

        Vector3d V = P - Pt;

        double Value = Math.Pow((V.SquareLength), 3 / 2);

        VSum -= new Vector3d(V.X / Value, V.Y / Value, V.Z / Value);
      }
      return VSum;

    }
  }
# ---------- end curve_potential ----------
gyroid = CSharpScript(Q=level, Reference="C:\USERS\DANIEL\DOCUMENTS\GITHUB\AETHER\BIN\Aether.dll")  # -> out, A; inputs Q: Double
# ---------- gyroid: C# ----------
    A = new SF(Q);
# ---------- gyroid: C# additional code ----------
  public class SF : ScalarField
  {
    public SF(){}
    double Q;
    public SF(double _Q)
    {
      Q = _Q;
    }
    public double ValueAt(Point3d P)
    {
      return
        (Math.Sin(P.X) * Math.Cos(P.Y) +
        Math.Sin(P.Y) * Math.Cos(P.Z) +
        Math.Sin(P.Z) * Math.Cos(P.X)) + Q;
    }
    public Vector3d GradientAt(Point3d P)
    {
      double x = P.X;
      double y = P.Y;
      double z = P.Z;
      return
        new Vector3d(
        Math.Cos(x) * Math.Cos(y) - Math.Sin(x) * Math.Sin(z),
        Math.Cos(y) * Math.Cos(z) - Math.Sin(x) * Math.Sin(y),
        Math.Cos(x) * Math.Cos(z) - Math.Sin(y) * Math.Sin(z));
    }
  }
# ---------- end gyroid ----------
rotate = Rotate(Angle=Slider(0.688, range=0..1), Plane=PlaneYZ(7, 5, 6.030309999))  # -> Geometry, Transform
scale = Scale(Center=Point(0, 0, 0), Factor=Slider(1.121, range=1..3))  # -> Geometry, Transform
comp = Compound(Transforms=[rotate.Transform, scale.Transform])
transformfield = CSharpScript(Q1=gyroid.A, X=comp, Reference="C:\USERS\DANIEL\DOCUMENTS\GITHUB\AETHER\BIN\Aether.dll")  # -> out, A; inputs X: Transform
# ---------- transformfield: C# ----------
    A = new SF(Q1 as ScalarField, X);
# ---------- transformfield: C# additional code ----------
  public class SF : ScalarField
  {
    ScalarField Input1;
    Transform Inverse;

    public SF(ScalarField _Input1, Transform _X)
    {
      Input1 = _Input1;
      var Inv = new Transform();
      _X.TryGetInverse(out Inv);
      Inverse = Inv;
    }
    public double ValueAt(Point3d P)
    {
      P.Transform(Inverse);
      return Input1.ValueAt(P);
    }
    public Vector3d GradientAt(Point3d P)
    {
      P.Transform(Inverse);
      return Input1.GradientAt(P);
    }
  }
# ---------- end transformfield ----------
addfields = CSharpScript(Q1=point_potential.A, Q2=curve_potential.A, Reference="C:\USERS\DANIEL\DOCUMENTS\GITHUB\AETHER\BIN\Aether.dll")  # -> out, A
# ---------- addfields: C# ----------
    A = new SF(Q1 as ScalarField, Q2 as ScalarField);
# ---------- addfields: C# additional code ----------
  public class SF : ScalarField
  {
    ScalarField Input1;
    ScalarField Input2;

    public SF(ScalarField _Input1, ScalarField _Input2)
    {
      Input1 = _Input1;
      Input2 = _Input2;
    }
    public double ValueAt(Point3d P)
    {
      return Input1.ValueAt(P) + Input2.ValueAt(P);
    }
    public Vector3d GradientAt(Point3d P)
    {
      return Input1.GradientAt(P) + Input2.GradientAt(P);
    }
  }
# ---------- end addfields ----------

# ---- group: Examples
list = ValueList({"Gyroid": 0, "Blobs": 1, "Curves": 2, "Curves+Blobs": 3}, selected="Curves+Blobs")

# ----
item = ListItem(List=[transformfield.A, point_potential.A, curve_potential.A, addfields.A], Index=list, Wrap=True)
aether_scalar_field = Data(item)
aether_marchingtruncatedoctahedra = CSharpScript(
    F=aether_scalar_field,
    Resolution=resolution,
    CellSize=division,
    Reference="C:\USERS\DANIEL\DOCUMENTS\GITHUB\AETHER\BIN\Aether.dll")  # -> out, W; inputs Resolution: Int32, CellSize: Double
# ---------- aether_marchingtruncatedoctahedra: C# ----------
    //Marching truncated octahedra
    //Daniel Piker 16/12/14

    ScalarField SF = F as ScalarField;

    //create a BCC lattice
    int XCells = Resolution;
    int YCells = Resolution;
    int ZCells = Resolution;

    double CS = CellSize;
    double CH = 0.5 * CS;
    double CQ = 0.25 * CS;

    var Grids = new Point3d[2][,,];
    Grids[0] = new Point3d[XCells, YCells, ZCells];
    Grids[1] = new Point3d[XCells, YCells, ZCells];

    var Signs = new bool[2][,,];
    Signs[0] = new bool[XCells, YCells, ZCells];
    Signs[1] = new bool[XCells, YCells, ZCells];

    for(int i = 0; i < XCells; i++)
    {
      for(int j = 0; j < YCells; j++)
      {
        for(int k = 0; k < ZCells; k++)
        {
          for(int g = 0; g < 2; g++)
          {
            Grids[g][i, j, k] = new Point3d(i * CS, j * CS, k * CS) + g * new Vector3d(CH, CH, CH);
            Signs[g][i, j, k] = (SF.ValueAt(Grids[g][i, j, k]) > 0);
          }
        }
      }
    }

    Mesh M = new Mesh();

    for(int i = 1; i < XCells - 1; i++)
    {
      for(int j = 1; j < YCells - 1; j++)
      {
        for(int k = 1; k < ZCells - 1; k++)
        {
          for(int g = 0; g < 2; g++)
          {
            int A = g;
            int B = 1 - g;
            // A truncated octahedron has 6 quad faces and 8 hex faces.
            // We only need to build half of these per point,
            // because we get the other half from the adjacent points.
            // So 3 quads and 4 hexagons (which we triangulate)

            //quads
            if(Signs[A][i, j, k] != Signs[A][i + 1, j, k])
            {
              Point3d P = Grids[A][i, j, k];
              int VCount = M.Vertices.Count;
              M.Vertices.Add(P.X + CH, P.Y + CQ, P.Z + 00);
              M.Vertices.Add(P.X + CH, P.Y + 00, P.Z + CQ);
              M.Vertices.Add(P.X + CH, P.Y - CQ, P.Z + 00);
              M.Vertices.Add(P.X + CH, P.Y + 00, P.Z - CQ);
              M.Faces.AddFace(VCount, VCount + 1, VCount + 2, VCount + 3);
            }
            if(Signs[A][i, j, k] != Signs[A][i, j + 1, k])
            {
              Point3d P = Grids[A][i, j, k];
              int VCount = M.Vertices.Count;
              M.Vertices.Add(P.X + CQ, P.Y + CH, P.Z + 00);
              M.Vertices.Add(P.X + 00, P.Y + CH, P.Z + CQ);
              M.Vertices.Add(P.X - CQ, P.Y + CH, P.Z + 00);
              M.Vertices.Add(P.X + 00, P.Y + CH, P.Z - CQ);
              M.Faces.AddFace(VCount, VCount + 1, VCount + 2, VCount + 3);
            }
            if(Signs[A][i, j, k] != Signs[A][i, j, k + 1])
            {
              Point3d P = Grids[A][i, j, k];
              int VCount = M.Vertices.Count;
              M.Vertices.Add(P.X + CQ, P.Y + 00, P.Z + CH);
              M.Vertices.Add(P.X + 00, P.Y + CQ, P.Z + CH);
              M.Vertices.Add(P.X - CQ, P.Y + 00, P.Z + CH);
              M.Vertices.Add(P.X + 00, P.Y - CQ, P.Z + CH);
              M.Faces.AddFace(VCount, VCount + 1, VCount + 2, VCount + 3);
            }
            //hexagons
            if(Signs[A][i, j, k] != Signs[B][i + g, j + g, k + g])
            {
              Point3d P = Grids[A][i, j, k];
              int VCount = M.Vertices.Count;
              M.Vertices.Add(P.X + CQ, P.Y + CQ, P.Z + CQ);

              M.Vertices.Add(P.X + CH, P.Y + CQ, P.Z + 00);
              M.Vertices.Add(P.X + CQ, P.Y + CH, P.Z + 00);
              M.Vertices.Add(P.X + 00, P.Y + CH, P.Z + CQ);
              M.Vertices.Add(P.X + 00, P.Y + CQ, P.Z + CH);
              M.Vertices.Add(P.X + CQ, P.Y + 00, P.Z + CH);
              M.Vertices.Add(P.X + CH, P.Y + 00, P.Z + CQ);

              M.Faces.AddFace(VCount, VCount + 1, VCount + 2);
              M.Faces.AddFace(VCount, VCount + 2, VCount + 3);
              M.Faces.AddFace(VCount, VCount + 3, VCount + 4);
              M.Faces.AddFace(VCount, VCount + 4, VCount + 5);
              M.Faces.AddFace(VCount, VCount + 5, VCount + 6);
              M.Faces.AddFace(VCount, VCount + 6, VCount + 1);
            }

            if(Signs[A][i, j, k] != Signs[B][i - 1 + g, j + g, k + g])
            {
              Point3d P = Grids[A][i, j, k];
              int VCount = M.Vertices.Count;
              M.Vertices.Add(P.X - CQ, P.Y + CQ, P.Z + CQ);

              M.Vertices.Add(P.X - CQ, P.Y + CH, P.Z + 00);
              M.Vertices.Add(P.X - CH, P.Y + CQ, P.Z + 00);
              M.Vertices.Add(P.X - CH, P.Y + 00, P.Z + CQ);
              M.Vertices.Add(P.X - CQ, P.Y + 00, P.Z + CH);
              M.Vertices.Add(P.X + 00, P.Y + CQ, P.Z + CH);
              M.Vertices.Add(P.X + 00, P.Y + CH, P.Z + CQ);

              M.Faces.AddFace(VCount, VCount + 1, VCount + 2);
              M.Faces.AddFace(VCount, VCount + 2, VCount + 3);
              M.Faces.AddFace(VCount, VCount + 3, VCount + 4);
              M.Faces.AddFace(VCount, VCount + 4, VCount + 5);
              M.Faces.AddFace(VCount, VCount + 5, VCount + 6);
              M.Faces.AddFace(VCount, VCount + 6, VCount + 1);
            }

            if(Signs[A][i, j, k] != Signs[B][i - 1 + g, j - 1 + g, k + g])
            {
              Point3d P = Grids[A][i, j, k];
              int VCount = M.Vertices.Count;
              M.Vertices.Add(P.X - CQ, P.Y - CQ, P.Z + CQ);

              M.Vertices.Add(P.X - CH, P.Y - CQ, P.Z + 00);
              M.Vertices.Add(P.X - CQ, P.Y - CH, P.Z + 00);
              M.Vertices.Add(P.X + 00, P.Y - CH, P.Z + CQ);
              M.Vertices.Add(P.X + 00, P.Y - CQ, P.Z + CH);
              M.Vertices.Add(P.X - CQ, P.Y + 00, P.Z + CH);
              M.Vertices.Add(P.X - CH, P.Y + 00, P.Z + CQ);

              M.Faces.AddFace(VCount, VCount + 1, VCount + 2);
              M.Faces.AddFace(VCount, VCount + 2, VCount + 3);
              M.Faces.AddFace(VCount, VCount + 3, VCount + 4);
              M.Faces.AddFace(VCount, VCount + 4, VCount + 5);
              M.Faces.AddFace(VCount, VCount + 5, VCount + 6);
              M.Faces.AddFace(VCount, VCount + 6, VCount + 1);
            }

            if(Signs[A][i, j, k] != Signs[B][i + g, j - 1 + g, k + g])
            {
              Point3d P = Grids[A][i, j, k];
              int VCount = M.Vertices.Count;
              M.Vertices.Add(P.X + CQ, P.Y - CQ, P.Z + CQ);

              M.Vertices.Add(P.X + CQ, P.Y - CH, P.Z + 00);
              M.Vertices.Add(P.X + CH, P.Y - CQ, P.Z + 00);
              M.Vertices.Add(P.X + CH, P.Y + 00, P.Z + CQ);
              M.Vertices.Add(P.X + CQ, P.Y + 00, P.Z + CH);
              M.Vertices.Add(P.X + 00, P.Y - CQ, P.Z + CH);
              M.Vertices.Add(P.X + 00, P.Y - CH, P.Z + CQ);

              M.Faces.AddFace(VCount, VCount + 1, VCount + 2);
              M.Faces.AddFace(VCount, VCount + 2, VCount + 3);
              M.Faces.AddFace(VCount, VCount + 3, VCount + 4);
              M.Faces.AddFace(VCount, VCount + 4, VCount + 5);
              M.Faces.AddFace(VCount, VCount + 5, VCount + 6);
              M.Faces.AddFace(VCount, VCount + 6, VCount + 1);
            }
          }
        }
      }
    }

    var Ms = M.SplitDisjointPieces();
    foreach (Mesh m in Ms)
    {
      m.UnifyNormals();
      m.Faces.ConvertQuadsToTriangles();

    }

    W = Ms;
# ---------- end aether_marchingtruncatedoctahedra ----------
wblaplace = WeaverbirdsLaplacianSmoothing(MeshCurves=aether_marchingtruncatedoctahedra.W, Level=3, SmoothNakedEdges=0, Thin=1)  # -> flatten(OutputMeshCurves)
demesh = DeconstructMesh(Mesh=wblaplace)  # -> Vertices, Faces, Colours, Normals
max_iterations = Panel("15")
accuracy = Panel("0.001")
aether_pulltolevelset = CSharpScript(
    F=aether_scalar_field,
    Pt=demesh.Vertices,
    Acc=accuracy,
    Iter=max_iterations,
    Reference="C:\Users\Daniel\Documents\GitHub\Aether\bin\Aether.dll")  # -> out, A; inputs Pt: list of Point3d, Acc: Double, Iter: Int32
# ---------- aether_pulltolevelset: C# ----------
    //Iterative pull to Level set of a field
    //Daniel Piker 16/12/14
    
    ScalarField SF = F as ScalarField;
    System.Threading.Tasks.Parallel.For(0, Pt.Count, j =>
      {
      if(Pt[j].IsValid)
      {
        {
          double FValue = 1.0;
          int counter = 0;
          while(Math.Abs(FValue) > Acc && counter < Iter) //accuracy and max iterations
          {
            FValue = SF.ValueAt(Pt[j]);
            Vector3d Gradient = SF.GradientAt(Pt[j]);
            Gradient *= 1.0 / Gradient.SquareLength;
            Pt[j] = Pt[j] - FValue * Gradient;
            counter++;
          }
        }
      }
      });
    A = Pt;
# ---------- end aether_pulltolevelset ----------
conmesh = ConstructMesh(Vertices=aether_pulltolevelset.A, Faces=demesh.Faces)
medges = MeshEdges(Mesh=conmesh)  # -> NakedEdges, InteriorEdges, NonManifoldEdges; disabled
preview = CustomPreview(
    Geometry=conmesh,
    Shader={ambient=RGB(128, 128, 128), diffuse=RGB(0, 192, 0), emission=RGB(0, 64, 0), shine=0.5, specular=RGB(255, 255, 255), transparency=0})
preview_2 = CustomPreview(
    Geometry=[medges.InteriorEdges, medges.NakedEdges],
    Shader={ambient=RGB(128, 128, 128), diffuse=RGB(0, 0, 0), emission=RGB(0, 0, 0), shine=0.5, specular=RGB(255, 255, 255), transparency=0})  # disabled
