# Grasshopper definition implicit_gyroid.gh (Grasshopper 0.9.76)

range = Range(Domain=Domain(-3.141592654, 3.141592654), Steps=20)
crossref = CrossReference(ListA=range, ListB=range, ListC=range, CrossMode=1)  # -> ListA, ListB, ListC
c_script = CSharpScript(
    Q=Slider(1.3, range=0..1.3),
    Reference="C:\Users\Daniel\Documents\Visual Studio 2013\Projects\Aether\Aether\bin\Release\Aether.dll")  # -> out, A; inputs Q: Double
# ---------- c_script: C# ----------
    A = new SF(Q);
# ---------- c_script: C# additional code ----------
  public class SF : ScalarField
  {
    public SF(){}
    double Q;
    public SF(double _Q)
    {
      Q = _Q;
    }
    public double ValueAt(Point3d P)
    {
      return
        Math.Sin(P.X) * Math.Cos(P.Y) +
        Math.Sin(P.Y) * Math.Cos(P.Z) +
        Math.Sin(P.Z) * Math.Cos(P.X) + Q;
    }
    public Vector3d GradientAt(Point3d P)
    {
      double x = P.X;
      double y = P.Y;
      double z = P.Z;
      return
        new Vector3d(
        Math.Cos(x) * Math.Cos(y) - Math.Sin(x) * Math.Sin(z),
        Math.Cos(y) * Math.Cos(z) - Math.Sin(x) * Math.Sin(y),
        Math.Cos(x) * Math.Cos(z) - Math.Sin(y) * Math.Sin(z)
        );
    }
  }
# ---------- end c_script ----------
pt = ConstructPoint(XCoordinate=crossref.ListA, YCoordinate=crossref.ListB, ZCoordinate=crossref.ListC)
c_script_2 = CSharpScript(
    F=c_script.A,
    Pt=pt,
    Reference="C:\Users\Daniel\Documents\Visual Studio 2013\Projects\Aether\Aether\bin\Release\Aether.dll")  # -> out, A; inputs Pt: list of Point3d
# ---------- c_script_2: C# ----------
    ScalarField SF = F as ScalarField;
    System.Threading.Tasks.Parallel.For(0, Pt.Count, j =>
      {
      if(Pt[j].IsValid)
      {
        {
          double FValue = 1.0;
          int counter = 0;
          while(Math.Abs(FValue) > 0.05 && counter < 100)
          {
            FValue = SF.ValueAt(Pt[j]);
            Vector3d Gradient = SF.GradientAt(Pt[j]);
            Gradient *= 1.0 / Gradient.SquareLength;
            Pt[j] = Pt[j] - FValue * Gradient;
            counter++;
          }
        }
      }
      });
    A = Pt;
# ---------- end c_script_2 ----------
pt_2 = Point(c_script_2.A)
